# Grasshopper definition gh_testSite_decoupling.gh (Grasshopper 1.0.7)
# plug-ins: TableUiAdapter

trigger = Trigger(Interval=50, TimerInterval=50, Target=tableui)  # disabled
tableui = TableUiAdapterComponent(Link="5005", Run=Toggle(True))  # -> Ids, Points, Rotation
c_script = CSharpScript(inputData=tableui.Ids)  # -> out, output
# ---------- c_script: C# ----------
    if (inputData == null)
    {
      return;
    }
    
    output = inputData;
# ---------- end c_script ----------
panel = Panel(c_script.output)
pt = Point(c_script.output)
